# Grasshopper definition DamianFrancoLA2.gh (Grasshopper 1.0.7)
# plug-ins: Pufferfish

geo = Geometry(<curve referenced from the Rhino model>)
# Large Assignment 2: Family of Vessels
# Name: Damian Franco
# E-mail: dfranco24@unm.edu
# Course: CS491/591, Computational Fabrication
# Submitted 2/27/2022
# 
# This program generates a model of a vessel
# from a user-drawn design within the Rhino
# interface. The user can use the sketch tool in
# Rhino to create a design that will transform into
# a vessel. Four curves are created within the
# Python code that allow for a vase-like vessel to
# be generated.
python = GhPythonScript(curve=geo)  # -> out, surface, curves; inputs curve: GeometryBase
# ---------- python: Python ----------
__author__ = "Damian"

import rhinoscriptsyntax as rs
import math
import copy
import Rhino.Geometry as geom

def translate(curve, x, y, z):
    translate = geom.Transform.Translation(x, y, z)
    curve.Transform(translate)

def scale(curve, x, y, z):
    plane = geom.Plane(rs.CreatePoint(0,0,0), rs.CreatePoint(1,0,0), rs.CreatePoint(0,1,0))
    scale = geom.Transform.Scale(plane, x, y, z)
    curve.Transform(scale)

def rotate(curve, xAngle, yAngle, zAngle):
    rotate = geom.Transform.RotationZYX(math.radians(zAngle), math.radians(yAngle), math.radians(xAngle))
    curve.Transform(rotate)

curves = []
#scale(curve, 2.5, 2.5, 0.1)
curves.append(curve)

#Top
curve2 = copy.copy(curve)
rotate(curve2, 0, 0, 0)
translate(curve2, 0, 0, 10)
scale(curve2, 0.5, 0.5, 0.3)
curves.append(curve2)

#Middle
curve3 = copy.copy(curve2)
rotate(curve3, 0, 0, 25)
translate(curve3, 0, 5, 20)
scale(curve2, 0.5, 0.5, 1.5)
curves.append(curve3)

#Bottom
curve4 = copy.copy(curve2)
rotate(curve4, 0, 0, 45)
translate(curve4, 0, 0, 30)
scale(curve2, 4.9, 4.9, 2.2)
curves.append(curve4)

surface = rs.AddLoftSrf(curves)
#a = curve2
# ---------- end python ----------
dam = DataDam(DataA=python.surface, BufferDelay=10000000, BufferMode=0)
crv = Curve(python.curves)
removal = Slider(0, range=0..20)
panel = Panel(python.out)
cap = CapHoles(Brep=dam)
shellpsrf = ShellPolysurface(Polysurface=cap, Removal=removal, Thickness=1, FaceMerge=False)
