# Grasshopper definition DamianFrancoSA3.gh (Grasshopper 1.0.7)
# plug-ins: Pufferfish

# Small Assignment 3: First 3D Print
# Name: Damian Franco
# E-mail: dfranco24@unm.edu
# Course: CS491/591, Computational Fabrication
# Submitted 2/21/2022
# 
# This program generates a 2.5D form, using the
# techniques that were taught to us within the
# class to create interesting point distributions.
# The techniques here refer to utilizing sliders to
# create equally distributed points and different
# more interesting distribution using the mod
# slider. Lines are also created between nearby
# points and turned into surfaces and extruded
pointsperside = Slider(6, range=2..50)
mod = Slider(6, range=0..30)
pt = Point(<point referenced from the Rhino model>)
pt_2 = Point(<point referenced from the Rhino model>)
python = GhPythonScript(pointsPerSide=pointsperside, p0=pt, p1=pt_2, mod=mod)  # -> out, a; inputs pointsPerSide: Int32, p0: Point3d, p1: Point3d
# ---------- python: Python ----------
__author__ = "Damian"

import rhinoscriptsyntax as rs

pointArray = []

spacing = (p1.X-p0.X)/pointsPerSide

for i in range(0, (pointsPerSide+1)):
    for j in range(0, (pointsPerSide+1)):
        if ((i*j*i + j*i*j) % mod == 0):
            x = p0.X + i*spacing
            y = p0.Y + j*spacing
            pointArray.append(rs.CreatePoint(x, y, 0))

a = pointArray
# ---------- end python ----------
pt_3 = Point(python.a)
threshold = Slider(15, range=0..30)
dam = DataDam(DataA=pt_3, BufferDelay=10000000, BufferMode=0)
python_2 = GhPythonScript(pointArray=dam, threshold=threshold)  # -> out, a; inputs pointArray: list of Point3d, threshold: Int32
# ---------- python_2: Python ----------
__author__ = "Damian"

import rhinoscriptsyntax as rs

lines = []

threshold2 = threshold*threshold

def distance2(p0, p1):
	return ((p1.X-p0.X)*(p1.X-p0.X) + (p1.Y-p0.Y)*(p1.Y-p0.Y))

for i in range(0, len(pointArray)):
	for j in range(0, len(pointArray)):
		if(i != j and distance2(pointArray[i], pointArray[j]) < threshold2):
			lines.append(rs.AddLine(pointArray[i], pointArray[j]))

a = lines
# ---------- end python_2 ----------
offcrv = OffsetCurve(Curve=python_2.a, Plane=PlaneXY(0, 0, 0), Distance=1, BothSides=0, Kinks=0, CapType=1)
boundary = BoundarySurfaces(Edges=offcrv)
extr = Extrude(Base=boundary, Direction=Vector(0, 0, 3))
