# Grasshopper definition DamianFrancoSA4.gh (Grasshopper 1.0.7)
# plug-ins: Pufferfish

top_width = Slider(12, range=0..30)
radius_bottom = Slider(7, range=0..30)
topfacets = Slider(20, range=0..20)
radius_mid = Slider(2, range=0..20)
radius_top = Slider(1, range=0..20)
height = Slider(13, range=0..50)
facets = Slider(4, range=0..20)
python = GhPythonScript(
    facets=facets,
    height=height,
    radius_top=radius_top,
    radius_mid=radius_mid,
    radius_bottom=radius_bottom,
    top_width=top_width,
    topFacets=topfacets)  # -> out, points, polygons, curves; inputs facets: Int32, height: Int32, topFacets: Int32
# ---------- python: Python ----------
__author__ = "Damian"
__version__ = "2022.02.22"

import rhinoscriptsyntax as rs
import math

def polyPoints(z, r):
    points = []
    for i in range(0, facets+1):
        angle = i*360/facets
        x = r*math.cos(math.radians(angle))
        y = r*math.sin(math.radians(angle))
        points.append(rs.CreatePoint(x,y,z))
    return points
    

def topPolyPoints(z, r):
    points = []
    for i in range(0, topFacets+1):
        angle = i*360/topFacets
        x = r*math.cos(math.radians(angle))
        y = r*math.sin(math.radians(angle))
        points.append(rs.CreatePoint(x,y,z))
    return points

def polygon(z, r, state):
    if state == 0:
        points = polyPoints(z, r)
        polygon = rs.AddPolyline(points)
        return polygon
    elif state == 1:
        points = topPolyPoints(z, r)
        polygon = rs.AddPolyline(points)
        return polygon
    

def curvePoly(z, r):
    points = polyPoints(z, r)
    curve = rs.AddCurve(points, 2)
    return curve
    

# a = amplitude, b = num of oscilations
def cosPoints(z, in_r, a, b):
    points = []
    for i in range(0, 360):
        r = in_r + a + a * math.cos(math.radians(i)*b)
        x = r*math.cos(math.radians(i))
        y = r*math.sin(math.radians(i))
        points.append(rs.CreatePoint(x,y,z))
    return points
    

def cosPoly(z, in_r, a, b):
    points = cosPoints(z, in_r, a, b)
    curve = rs.AddCurve(points)
    curve = rs.CloseCurve(curve,1)
    return curve 


# regular polygon
polygons = []
polygons.append(polygon(0, radius_bottom, 0))
polygons.append(polygon(height/2, radius_mid, 0))
polygons.append(polygon(height, radius_top, 0))

# cos curve
#curves = []
#curves.append(cosPoly(0, radius_bottom, 5, 5))
#curves.append(cosPoly(height/2, radius_mid, 5, 5))
#curves.append(cosPoly(height, radius_top, 5, 5))

# regular curve
#curves = []
#curves.append(curvePoly(0, radius_bottom))
#curves.append(curvePoly(height/2, radius_mid))
#curves.append(curvePoly(height, radius_top))

curves = []
curves.append(polygon(height, top_width, 1))
# ---------- end python ----------
panel = Panel(python.curves)
offcrv = OffsetCurve(Curve=python.curves, Plane=PlaneXY(0, 0, 0), Distance=1, BothSides=0, Kinks=0, CapType=1)
thickness = Slider(1, range=0..6)
panel_2 = Panel(python.out)
panel_3 = Panel(python.polygons)
offcrv_2 = OffsetCurve(Curve=python.polygons, Plane=PlaneXY(0, 0, 0), Distance=thickness, BothSides=0, Kinks=0, CapType=1)
item = ListItem(List=offcrv, Index=0, Wrap=True)
loft = Loft(Curves=python.polygons, Options={Adjust=False, Closed=False, LoftEnds=0, LoftSimp=0, LoftType=0, Rebuild=10, Refit=0.01})
item_2 = ListItem(List=flatten(offcrv_2), Index=0, Wrap=True)
loft_2 = Loft(
    Curves=flatten(offcrv_2),
    Options={Adjust=False, Closed=False, LoftEnds=0, LoftSimp=0, LoftType=0, Rebuild=10, Refit=0.01})
boundary = BoundarySurfaces(Edges=item)
cap = CapHoles(Brep=loft)
boundary_2 = BoundarySurfaces(Edges=item_2)
cap_2 = CapHoles(Brep=loft_2)
extr = Extrude(Base=boundary, Direction=Vector(0, 0, 5))
extr_2 = Extrude(Base=boundary_2, Direction=Vector(0, 0, -3))
sdiff = SolidDifference(BrepsA=cap_2, BrepsB=cap)
merge = Merge(Data1=sdiff, Data2=extr_2, Data3=extr)
sunion = SolidUnion(Breps=flatten(merge))
panel_4 = Panel(sunion)
