# Grasshopper definition BotanicalGeneration.gh (Grasshopper 1.0.7)
# plug-ins: Shortest Walk in Gh

# ----
# Group 1:
# Make the orginal geometry for area
number_slider = Slider(1, range=0..1)
number_slider_2 = Slider(15, range=0..100)
# Final Project: Botanical Generation
# Name: Meling Traeger
#              Damian Franco
# E-mail: meilingt@unm.edu
#              dfranco24@unm.edu
# Course: CS491/591, Computational Fabrication
# Submitted 5/3/2022
# 
# This program creates our botanical forms.
# 
# 
# Group 1 creates the rectangular box to act
# as an area that we can place points and
# edges within for the shortest walk plugin to
# work its magic on.
# 
# Group 2 adds a bounding box to our
# rectangular object to fully create the area
# that we are going to place points in.
# 
# 
# Group 3 randomizes about 500-5000
# points within this area. This parameter is
# dynamically changed by the user with
# number sliders and is the main
# randomizing factor for different bontainical
# forms generated.
# 
# Group 4 generates edges between each
# random point and their closest neighbors.
# 
# Group 5, we apply the Shortest
# Walk plugin to our form to create the
# botanical form. This plugin uses two points
# as a reference and finds the shortest path
# from the starting point to the ending point.
# The starting point in our case would be the
# randomized point with the least value in the
# Z-axis. This point will be selected and the
# ending point was selected randomly out of
# all the various points within the bounding
# box.
# 
# Group 6 makes a circular support cap at
# the bottom with the use of geometry and
# extrude.
pt = ConstructPoint(XCoordinate=0, YCoordinate=0, ZCoordinate=0)
addition = Addition(B=number_slider_2)
addition_2 = Addition(A=number_slider, B=Slider(0, range=0..100))
neg = Negative(Value=number_slider_2)
line = LineSDL(Start=pt, Direction=Vector(0, 0, 1), Length=Slider(0, range=0..10))
pt_2 = ConstructPoint(XCoordinate=0, YCoordinate=0, ZCoordinate=addition)
sph = Sphere(Base=PlaneXY(0, 0, 0), Radius=number_slider_2)
subtraction = Subtraction(A=neg, B=addition_2)
line_2 = LineSDL(Start=pt_2, Direction=Vector(0, 0, 1), Length=Slider(24, range=0..100))
pt_3 = ConstructPoint(XCoordinate=0, YCoordinate=0, ZCoordinate=subtraction)
deform = SpatialDeform(Geometry=sph, Syntax=[pt, pt_2], Forces=[line, line_2])

# ----
# Group 3:
# Randomize points in box
number_slider_3 = Slider(0.3, range=0..1)
number_slider_4 = Slider(10, range=0..100)
dom = ConstructDomain(DomainStart=number_slider_3, DomainEnd=1)
random = Random(Range=Domain(0, 1), Number=number_slider_4, Seed=2)
random_2 = Random(Range=dom, Number=number_slider_4, Seed=2)
pt_4 = ConstructPoint(XCoordinate=random, YCoordinate=random_2, ZCoordinate=0)
evalsrf = EvaluateSurface(Surface=reparameterize(deform), Point=pt_4)  # -> Point, Normal, UDirection, VDirection, Frame

# ----
# Group 2:
# Create bounding box
# Populate box with points
number_slider_5 = Slider(150, range=0..10000)
bbox = BoundingBox(Content=deform, Plane=PlaneXY(0, 0, 0))  # -> Box, Box_2
pop3d = Populate3D(Region=bbox.Box, Count=number_slider_5, Seed=1)

# ----
# Group 4:
# Shortest Walk to create form
pt_5 = Point(evalsrf.Point)
pt_6 = Point(flatten([pt_5, pop3d, pt_3]))
ln = Line(StartPoint=pt_3, EndPoint=pt_5)
prox = Proximity3D(Points=flatten(pt_6), Group=5)  # -> flatten(Links), Topology

shortwalk = ShortestWalk(Curves=prox.Links, WantedPath=ln)  # -> ShortestWalk, Succession, Direction, Length

# ----
# Group 5:
# Creates full 3D model of botanical
number_slider_6 = Slider(1, range=0..1)
disc = Discontinuity(Curve=reparameterize(shortwalk.ShortestWalk), Level=1)  # -> Points, simplify(Parameters)
dom_2 = ConstructDomain(DomainStart=number_slider_6, DomainEnd=Slider(0.05, range=0..0.1))
lng = ListLength(List=disc.Points)
remap = RemapNumbers(Value=disc.Parameters, Source=Domain(0, 1), Target=dom_2)  # -> Mapped, Clipped
knots = KnotVector(Count=lng, Degree=3, Periodic=False)
nurbcrv = NurbsCurvePWK(Points=disc.Points, Knots=knots)  # -> Curve, Length, Domain
vpipe = PipeVariable(Curve=reparameterize(graft(nurbcrv.Curve)), Parameters=disc.Parameters, Radii=remap.Mapped, Caps=0)
cap = CapHoles(Brep=vpipe)

# ----
# Group 6:
# Create base stand
number_slider_7 = Slider(3, range=0..10)
pt_7 = Point(<point referenced from the Rhino model>)
cir = Circle(Plane=pt_7, Radius=Slider(8, range=0..10))
Z = UnitZ(Factor=number_slider_7)
extr = Extrude(Base=cir, Direction=Z)
cap_2 = CapHoles(Brep=extr)

sunion = SolidUnion(Breps=[cap, cap_2])
