# Grasshopper definition HutGeneration.gh (Grasshopper 1.0.7)

# ----
# Group 1:
# Select circle geometry with points
number_slider = Slider(0.25, range=0..1)
# Final Project: Hut Generation
# Name: Meling Traeger
#              Damian Franco
# E-mail: meilingt@unm.edu
#              dfranco24@unm.edu
# Course: CS491/591, Computational Fabrication
# Submitted 5/3/2022
# 
# This program creates our fish hut structure.
# 
# Group 1 must be connected to a circle
# geometry within Rhino. This circle would
# act as a base for the hut that we were
# creating.
# 
# Group 2 creates a circle base for the hut to
# sit on.
# 
# Group 3 create points on the geometry
# then reflects those same points on the
# other side of the circle. This created our
# points that we want to start generating the
# hut side, and allowed us to manipulate the
# points to give this a “door” on a single
# side.
# 
# Group 4 has a catenary block that is used
# to create lines between the points that can
# be used as a basis for the hut structure
# itself.  The most important factor for this structure
# was the length input which would
# determine the main structure of the hut. We
# put two sliders that controlled two sides of
# the structure's height and overall form.
crv = Curve(<curve referenced from the Rhino model>)
seam = Seam(Curve=reparameterize(crv), Seam=number_slider)

# ----
# Group 3:
# Create points on circle
number_slider_2 = Slider(0.36, range=0..1)
dom = ConstructDomain(DomainStart=Slider(0.14, range=0..1), DomainEnd=number_slider_2)
dom_2 = ConstructDomain(DomainStart=Slider(0.64, range=0..1), DomainEnd=Slider(0.87, range=0..1))
subcrv = SubCurve(BaseCurve=reparameterize(seam), Domain=dom)
subcrv_2 = SubCurve(BaseCurve=reparameterize(seam), Domain=dom_2)

# ----
# Group 2:
# Create base stand
number_slider_3 = Slider(1, range=-5..10)
cir = Circle(Plane=crv, Radius=Slider(15, range=0..100))
Z = UnitZ(Factor=number_slider_3)
extr = Extrude(Base=cir, Direction=Z)
cap = CapHoles(Brep=extr)

# ----
# Group 4:
# Create fish hut model
number_slider_4 = Slider(0.465, range=0..1)
number_slider_5 = Slider(15, range=0..100)
Z_2 = UnitZ(Factor=1)
dom_3 = ConstructDomain(DomainStart=number_slider_4, DomainEnd=Slider(0.93, range=0..1))
divide = DivideCurve(Curve=subcrv_2, Count=number_slider_5, Kinks=False)  # -> Points, Tangents, Parameters
divide_2 = DivideCurve(Curve=subcrv, Count=number_slider_5, Kinks=False)  # -> reverse(Points), Tangents, Parameters
points = PointList(Points=divide_2.Points)
range = Range(Domain=dom_3, Steps=10)
points_2 = PointList(Points=divide.Points)
multiplication = Multiplication(A=Slider(50, range=0..100), B=range)
cat = Catenary(PointA=divide_2.Points, PointB=divide.Points, Length=multiplication, Gravity=Z_2)
crv_2 = Curve(cat)
reb = RebuildCurve(Curve=crv_2, Degree=Slider(3, range=0..10), Count=Slider(28, range=0..100), Tangents=False)
loft = Loft(Curves=reb, Options={Adjust=False, Closed=False, LoftEnds=0, LoftSimp=0, LoftType=0, Rebuild=10, Refit=0.01})
Z_3 = UnitZ(Factor=Slider(2, range=0..10))
extr_2 = Extrude(Base=loft, Direction=Z_3)

sunion = SolidUnion(Breps=[extr_2, cap])
