# Grasshopper definition PebbleGeneration.gh (Grasshopper 1.0.7)

radius_bottom = Slider(2, range=0..30)
radius_mid = Slider(8, range=0..20)
radius_top = Slider(1, range=0..20)
curvature = Slider(2.76, range=0..10)
height = Slider(7, range=0..50)
python = GhPythonScript(curvature=curvature, height=height, radius_top=radius_top, radius_mid=radius_mid, radius_bottom=radius_bottom)  # -> out, curves; inputs curvature: Int32, height: Int32
# ---------- python: Python ----------
import rhinoscriptsyntax as rs
import math

def polyPoints(z, r):
    points = []
    for i in range(0, curvature+1):
        angle = i*360/curvature
        x = r*math.cos(math.radians(angle))
        y = r*math.sin(math.radians(angle))
        points.append(rs.CreatePoint(x,y,z))
    return points
    


def curvePoly(z, r):
    points = polyPoints(z, r)
    curve = rs.AddCurve(points, 2)
    return curve
    

# generate pebbles
curves = []
curves.append(curvePoly(0, radius_bottom))
curves.append(curvePoly(height/2, radius_mid))
curves.append(curvePoly(height, radius_top))
# ---------- end python ----------
# Final Project: Pebble Generation
# Name: Meling Traeger
#              Damian Franco
# E-mail: meilingt@unm.edu
#              dfranco24@unm.edu
# Course: CS491/591, Computational Fabrication
# Submitted 5/3/2022
# 
# This program creates multiple iterations of
# "pebbles" and is derived from the original
# polygon vase vessel grasshopper example in
# class. We use multiple inputs to keep track
# of the three curves that create the pebbles.
loft = Loft(Curves=python.curves, Options={Adjust=False, Closed=False, LoftEnds=0, LoftSimp=0, LoftType=0, Rebuild=10, Refit=0.01})
cap = CapHoles(Brep=loft)
