# Grasshopper definition Wave Generation.gh (Grasshopper 1.0.7)

num_tiles = Slider(5, range=0..10)
size = Slider(5, range=0..10)
# Group 1
# Making the tiles.
geo = Geometry(<curve referenced from the Rhino model>)
# Final Project: Wave Generation
# Name: Meling Traeger
#              Damian Franco
# E-mail: meilingt@unm.edu
#              dfranco24@unm.edu
# Course: CS491/591, Computational Fabrication
# Submitted 5/9/2022
# 
# Used the same generation as Large
# Assignment 3.
# 
# This program generates a three dimensional
# model based on a geometrically input given in
# Rhino. The geomotry will be take and made
# duplicated for a tiling effect. After, the tiling will
# be used to display on a plane given by the user.
# There are four options for planes within the
# python code block in group 2.
boundary = BoundarySurfaces(Edges=geo, UseTasks=True)
Z = UnitZ(Factor=1)
extr = Extrude(Base=boundary, Direction=Z)
mirror = Mirror(Geometry=extr, Plane=Plane(origin=(0, 0, 0), x=(0, 0, 1), y=(1, 0, 0)))  # -> Geometry, Transform
python = GhPythonScript(mirror_tile=mirror.Geometry, tile=extr, size=size, num_tiles=num_tiles)  # -> out, tiles; inputs mirror_tile: GeometryBase, tile: GeometryBase, num_tiles: Int32
# ---------- python: Python ----------
__author__ = "Damian"

import rhinoscriptsyntax as rs
import math
import copy
import Rhino.Geometry as geom

# g = geomotry object
def translate(g, x, y, z):
    translation = geom.Transform.Translation(x, y, z)
    g.Transform(translation)

height = size*math.sin(math.radians(60))
translate(mirror_tile, size/2, height, 0)
tiles = []
for i in range(0, num_tiles):
    for j in range(0, num_tiles):
        tile_temp = copy.deepcopy(tile)
        tile_temp_m = copy.deepcopy(mirror_tile)
        if((j%2) == 0):
            translate(tile_temp, size*i, height*j, 0)
            translate(tile_temp_m, size*i, height*j, 0)
        else:
            translate(tile_temp, size*i-size/2, height*j, 0)
            translate(tile_temp_m, size*i-size/2, height*j, 0)
        tiles.append(tile_temp)
        tiles.append(tile_temp_m)
# ---------- end python ----------

multiplication = Multiplication(A=size, B=num_tiles)

# ----
# Group 2
# Making the plane.
number_slider = Slider(0.83, range=0..1)
dom = ConstructDomain(DomainStart=Slider(-0.85, range=-1..1), DomainEnd=number_slider)
range = Range(Domain=dom, Steps=Slider(50, range=0..100))
python_2 = GhPythonScript(size=multiplication, in_range=range, scale=Slider(68, range=0..100))  # -> out, surface; inputs size: Int32, in_range: list, scale: Int32
# ---------- python_2: Python ----------
__author__ = "Damian"

import rhinoscriptsyntax as rs
import math

curves = []
for i in range(0, len(in_range)):
    points = []
    for j in range(0, len(in_range)):
        x = in_range[i]
        y = in_range[j]
        r = math.sqrt(x*x+y*y)
        # Exponetial forms
        #z = math.exp(-0.25*(math.pi*x*y))
        #z = math.exp(-2*(x*x+y*y))
        
        # Trig forms
        #z = math.sin(x*math.pi)*math.cos(y*math.pi)
        #z = math.cos(y*math.pi)
        
        # Cylinder forms
        #z = r/math.cos(math.radians(30))
        z = r*r*math.sin(math.radians(145))
        points.append(rs.CreatePoint(x*size, y*size, z*scale))
    curves.append(rs.AddCurve(points))

surface = rs.AddLoftSrf(curves)
# ---------- end python_2 ----------

bbox = BoundingBox(Content=extr, Plane=PlaneXY(0, 0, 0))  # -> Box, Box_2

dam = DataDam(DataA=python.tiles, DataB=bbox.Box, DataC=python_2.surface, DataD=num_tiles, BufferDelay=10000000, BufferMode=0)  # -> DataA, DataB, DataC, DataD
# Group 3
# Morphing the
# tiles to the plane
division = Division(A=1, B=dam.DataD)
srfmorph = SurfaceMorph(
    Geometry=dam.DataA,
    Reference=dam.DataB,
    Surface=reparameterize(dam.DataC),
    UDomain=division,
    VDomain=division,
    WDomain=Slider(1, range=0..1))
